# Grasshopper definition IPC_Srf Type A.gh (Grasshopper 1.0.7)
# plug-ins: Kangaroo2 Components

brep = Brep(<brep referenced from the Rhino model>)
direction_0_1 = GetInteger(Slider(1, range=0..1), AtLeast=1, AtMost=1, Maximum=2147483647, Minimum=-2147483648, TreeAccess=False)
surface = GetGeometry(brep, AtLeast=1, AtMost=1, DeleteInput=False, Filter=1074004029, TreeAccess=False)
division_1 = GetInteger(Slider(6, range=0..100), AtLeast=1, AtMost=1, Maximum=2147483647, Minimum=-2147483648, TreeAccess=False)
division_2 = GetInteger(Slider(24, range=0..100), AtLeast=1, AtMost=1, Maximum=2147483647, Minimum=-2147483648, TreeAccess=False)
edges = BrepEdges(Brep=surface)  # -> Naked, Interior, NonManifold
join = JoinCurves(Curves=edges.Naked, Preserve=False)
explode = Explode(Curve=join, Recursive=True)  # -> Segments, Vertices
item = ListItem(List=explode.Segments, Index=direction_0_1, Wrap=True)  # -> Item, Item1, Item2, Item3
flip = FlipCurve(Curve=item.Item2)  # -> Curve, Flag
merge = Merge(Data1=item.Item, Data2=flip.Curve)
divide = DivideCurve(Curve=merge, Count=division_1, Kinks=False)  # -> Points, Tangents, Parameters
panel = Panel("""True
False""")
flip_2 = FlipMatrix(Data=divide.Points)
pline = PolyLine(Vertices=flip_2, Closed=False)  # -> simplify(Polyline)
rev = ReverseList(List=flatten(pline))
panel_2 = Panel(panel)
shift = ShiftList(List=rev, Shift=Slider(0, range=0..1), Wrap=False)
dispatch = Dispatch(List=flatten(pline), DispatchPattern=panel)  # -> ListA, ListB
dispatch_2 = Dispatch(List=flatten(shift), DispatchPattern=panel_2)  # -> ListA, ListB
divide_2 = DivideCurve(Curve=dispatch.ListA, Count=division_2, Kinks=False)  # -> Points, Tangents, Parameters
divide_3 = DivideCurve(Curve=dispatch.ListB, Count=division_2, Kinks=False)  # -> Points, Tangents, Parameters
divide_4 = DivideCurve(Curve=dispatch_2.ListA, Count=division_2, Kinks=False)  # -> Points, Tangents, Parameters
divide_5 = DivideCurve(Curve=dispatch_2.ListB, Count=division_2, Kinks=False)  # -> Points, Tangents, Parameters
not = GateNot(A=panel)
not_2 = GateNot(A=panel_2)
dispatch_3 = Dispatch(List=divide_3.Points, DispatchPattern=not)  # -> ListA, ListB
dispatch_4 = Dispatch(List=divide_2.Points, DispatchPattern=panel)  # -> ListA, ListB
dispatch_5 = Dispatch(List=divide_5.Points, DispatchPattern=not_2)  # -> ListA, ListB
dispatch_6 = Dispatch(List=divide_4.Points, DispatchPattern=panel_2)  # -> ListA, ListB
pt = Point(dispatch_4.ListA)
pt_2 = Point(dispatch_3.ListA)
pt_3 = Point(dispatch_6.ListA)
pt_4 = Point(dispatch_5.ListA)
number_slider = Slider(20000, range=0..100000)
number_slider_2 = Slider(20000, range=0..100000)
pline_2 = PolyLine(Vertices=pt_3, Closed=False)
pline_3 = PolyLine(Vertices=pt, Closed=False)
ext = ExtendCurve(Curve=pline_2, Type=0, Start=number_slider, End=number_slider)
ext_2 = ExtendCurve(Curve=pline_3, Type=0, Start=number_slider_2, End=number_slider_2)
lng = ListLength(List=pt_2)
repeat = RepeatData(Data="0", Length=lng)
merge_2 = Merge(Data1=pt, Data2=pt_2)
merge_3 = Merge(Data1=pt_3, Data2=pt_4)
item_2 = ListItem(List=repeat, Index=0, Wrap=True)
item_3 = ListItem(List=divide_3.Points, Index=0, Wrap=True)  # -> Item1, Item
alongcrv = SortAlongCurve(Points=merge_2, Curve=ext_2)  # -> Points, Indices
alongcrv_2 = SortAlongCurve(Points=merge_3, Curve=ext)  # -> Points, Indices
merge_4 = Merge(Data1=simplify(graft(item_2)), Data2=simplify(lng))
pline_4 = PolyLine(Vertices=pt, Closed=False)
pline_5 = PolyLine(Vertices=alongcrv.Points, Closed=False)
pline_6 = PolyLine(Vertices=alongcrv_2.Points, Closed=False)
ins = InsertItems(List=pt_2, Item=[item_3.Item, item_3.Item1], Indices=merge_4, Wrap=True)
pline_7 = PolyLine(Vertices=ins, Closed=False)
pline_8 = PolyLine(Vertices=pt_2, Closed=False)
explode_2 = Explode(Curve=pline_5, Recursive=True)  # -> Segments, Vertices
explode_3 = Explode(Curve=pline_6, Recursive=True)  # -> Segments, Vertices
explode_4 = Explode(Curve=pline_4, Recursive=True)  # -> Segments, Vertices
explode_5 = Explode(Curve=pline_7, Recursive=True)  # -> Segments, Vertices
explode_6 = Explode(Curve=pline_8, Recursive=True)  # -> Segments, Vertices
item_4 = ListItem(List=explode_5.Segments, Index=0, Wrap=True)  # -> Item1, Item
dupln = RemoveDuplicateLines(Lines=flatten([explode_2.Segments, explode_3.Segments, explode_4.Segments, explode_6.Segments]), Tolerance=0.01)
crv = Curve(simplify([item_4.Item1, item_4.Item]))
context_bake = ContextBake(CrvType2=crv)
context_bake_2 = ContextBake(CrvType1=dupln)
